# Dynamo graph Hangman4Revit.dyn "Hangman5" (Dynamo 2.6.1.8786)
# packages: Clockwork for Dynamo 2.x 2.3.0, Rhythm 2021.6.1, archi-lab.net 2021.25.2621

# group: POPUPS
# note: USE:
# Pop ups
# note: ________________________________________________________

# group: SCRIPT DESIGN
# note: ________________________________________________________
# note: USE:
# FOR THE BACK-END FUNCTIONALITY

# group: FROM DYNAMO
# note: ________________________________________________________
# note: USE:
# Export TO Revit (geometry and parameters etc.)

# group: TO DYNAMO
# note: ________________________________________________________
# note: USE:
# Incoming references (File paths, geometry ... )

# group: User Input
# note: ________________________________________________________
# note: USE:
# User input (for eg. sliders, numbers, ....)

# group: MONITOR
# note: USE:
# Stuff you probably want to check
# note: ________________________________________________________

# group: Packages used
# note: Clockwork v.1.0.2
# Rhythm v.2021.6.1
# archilab v.2021.25.2621
# note: ________________________________________________________

# group: TODO
# note: Final letter doesn't 'print' if you win
# Dunno, make forms sexier?
# Add some better graphics?
# note: ________________________________________________________

# group: Instructions for Hangman
# note: How to play
# 1 - Use a TOTALLY BLANK Revit file.
# 2 - Open in Dynamo player.
# 3 - Click run + The game sets
# 4 - Click run + enter a letter.
# 5 - Repeat step 3 until game over
# 6 - Click the reset button
# 7 - Go to step 1
# note: ________________________________________________________
# note: Points to note
# 'Name' may not work well on your system. See notes.
# Current language is English. If you want another language you need to find a URL with your language list + amend the Python clean up node accordingly.
# See 'word - imported' group.

# group: Revit project name
code_block = CodeBlock { "Project Information"; }
byName = Category.ByName(name=code_block)
all_elements_of_category = ElementsOfCategory(Category=byName)
code_block_2 = CodeBlock { "Project Name"; }
getParameterValueByName = Element.GetParameterValueByName(element=all_elements_of_category, parameterName=code_block_2, lacing=Longest)

code_block_3 = CodeBlock(ProjectName=getParameterValueByName) { ProjectName != "Hangman" ? 1 : "Hangman"; }

# group: The Revit active view
current = Document.Current()
activeView = Document.ActiveView(document=current)

code_block_4 = CodeBlock(NEW=code_block_3, view=activeView) { NEW == 1 ? view : ""; }

# group: Dashes for letters
code_block_5 = CodeBlock()
# ---------- code_block_5.designscript (10 lines) ----------
[ Point.ByCoordinates (15000,0, 0),
  Point.ByCoordinates (15500,0, 0),
  Point.ByCoordinates (16000,0, 0),
  Point.ByCoordinates (16500,0, 0),
  Point.ByCoordinates (17000,0, 0),
  Point.ByCoordinates (17500,0, 0),
  Point.ByCoordinates (18000,0, 0),
  Point.ByCoordinates (18500,0, 0),
  Point.ByCoordinates (19000,0, 0),
  Point.ByCoordinates (19500,0, 0)];
# ----------------------------------------
code_block_6 = CodeBlock()
# ---------- code_block_6.designscript (10 lines) ----------
[Point.ByCoordinates (15400,0, 0),
  Point.ByCoordinates (15900,0, 0),
  Point.ByCoordinates (16400,0, 0),
  Point.ByCoordinates (16900,0, 0),
  Point.ByCoordinates (17400,0, 0),
  Point.ByCoordinates (17900,0, 0),
  Point.ByCoordinates (18400,0, 0),
  Point.ByCoordinates (18900,0, 0),
  Point.ByCoordinates (19400,0, 0),
  Point.ByCoordinates (19900,0, 0)];
# ----------------------------------------
byStartPointEndPoint = Line.ByStartPointEndPoint(startPoint=code_block_5, endPoint=code_block_6)

# group: word - imported
# note: Website with words
string = StringInput("https://www.mit.edu/~ecprice/wordlist.10000")
web_request = WebRequest(url=string)
# note: Generate a word.
# OUT
# [0] word
# [1] word length
python_script = Python(IN[0]=code_block_3, IN[1]=web_request)
# ---------- python_script.python (26 lines) ----------
# Load the Python Standard and DesignScript Libraries
import sys
import clr
clr.AddReference('ProtoGeometry')
from Autodesk.DesignScript.Geometry import *
import random

	
if IN[0][0] == 1:

	words = IN[1].split()
	
	
	GameWords = [] 
	
	for i in words:
	    if len(i) < 5:
	        continue
	    elif len(i) > 10:
	        continue
	    else:
	        GameWords.append(i)
	        
	GameWord = random.choice(GameWords)
	
	OUT = GameWord.upper() , len(GameWord)
# ----------------------------------------

# group: Get the right number of dashes
code_block_7 = CodeBlock(i=python_script) { i[1]; }
# note: Create sequence 0 - x
# (a dash for each letter)
code_block_8 = CodeBlock(i=code_block_7) { 0..(i-1); }
getItemAtIndex = List.GetItemAtIndex(list=byStartPointEndPoint, index=code_block_8)

# group: Create dashes in Revit
byCurve = DetailCurve.ByCurve(view=code_block_4@L1, curve=getItemAtIndex)

# group: Name
# note: This may need amending dependent on your system
python_script_2 = Python()  # graph input
# ---------- python_script_2.python (8 lines) ----------
import clr
from System import Environment

sys_name = Environment.UserName

first_name = sys_name.split(".")[0]

OUT = first_name
# ----------------------------------------

code_block_9 = CodeBlock(OneOrHangman=code_block_3) { OneOrHangman; }

# group: Box for filled region
code_block_10 = CodeBlock()
# ---------- code_block_10.designscript (4 lines) ----------
lowPt = Point.ByCoordinates(14809.546,9691.471);
hghPt =Point.ByCoordinates(20009.546,8067.841);
Rectangle.ByCornerPoints(lowPt,Point.ByCoordinates(lowPt.X,hghPt.Y),
hghPt,Point.ByCoordinates(hghPt.X,lowPt.Y));
# ----------------------------------------
explode = Geometry.Explode(geometry=code_block_10.out2)

code_block_11 = CodeBlock(i=python_script) { i[0]; }
code_block_12 = CodeBlock(CorrectLetterLocation=byStartPointEndPoint) { CorrectLetterLocation; }
code_block_13 = CodeBlock(CorrectLetterLocation=code_block_12) { CorrectLetterLocation; }

# group: Letter position for all guesses
code_block_14 = CodeBlock { 15575..19075..500; [9550, 9130, 8710]; }
byCoordinates = Point.ByCoordinates(x=code_block_14.out0, y=code_block_14.out1, lacing=CrossProduct)
transpose = List.Transpose(lists=byCoordinates)
flatten = List.Flatten(list=transpose)

# group: Head and body in Dynamo
code_block_15 = CodeBlock { Point.ByCoordinates(19029.546,6219.151); 500; }
# note: Head
byCenterPointRadius = Circle.ByCenterPointRadius(centerPoint=code_block_15.out0, radius=code_block_15.out1)
code_block_16 = CodeBlock()
# ---------- code_block_16.designscript (7 lines) ----------
//Start points
[Point.ByCoordinates(19029.546, 5719.151),
Point.ByCoordinates(19029.546,4843.281),
Point.ByCoordinates(19029.546,4843.281),
Point.ByCoordinates(19029.546,3419.151),
Point.ByCoordinates(19029.546,3419.151)
];
# ----------------------------------------
code_block_17 = CodeBlock()
# ---------- code_block_17.designscript (7 lines) ----------
//End points
[Point.ByCoordinates(19029.546, 3419.151),
Point.ByCoordinates(17829.546,4843.281),
Point.ByCoordinates(20229.546,4843.281),
Point.ByCoordinates(18077.036,1894.816),
Point.ByCoordinates(19982.056,1894.816)
];
# ----------------------------------------
# note: Body
byStartPointEndPoint_2 = Line.ByStartPointEndPoint(startPoint=code_block_16, endPoint=code_block_17)

code_block_18 = CodeBlock(Head=byCenterPointRadius, Body=byStartPointEndPoint_2) { DSCore.List.Flatten([Head, Body]); }

# group: Draw gallows in Dynamo
code_block_19 = CodeBlock()
# ---------- code_block_19.designscript (7 lines) ----------
[
Point.ByCoordinates(20009.546,7643.281),
Point.ByCoordinates(14809.546,7643.281),
Point.ByCoordinates(14809.546,843.281),
Point.ByCoordinates(14809.546,1843.281),
Point.ByCoordinates(15809.546,7643.281),
Point.ByCoordinates(19009.546,7643.281)];
# ----------------------------------------
code_block_20 = CodeBlock()
# ---------- code_block_20.designscript (6 lines) ----------
[Point.ByCoordinates(14809.546,7643.281),
Point.ByCoordinates(14809.546,843.281),
Point.ByCoordinates(20009.546,843.281),
Point.ByCoordinates(15809.546,843.281),
Point.ByCoordinates(14809.546,6643.281),
Point.ByCoordinates(19009.546,6818.817)];
# ----------------------------------------
byStartPointEndPoint_3 = Line.ByStartPointEndPoint(startPoint=code_block_19, endPoint=code_block_20)

code_block_21 = CodeBlock(a=explode, b=byStartPointEndPoint_3) { [a , b ]; }

# group: To Revit - Draw gallows + filled region + letters guessed box Fill in Type Mark of filled region
# note: Filled region type
python_script_3 = Python()  # unwired: IN[0]
# ---------- python_script_3.python (18 lines) ----------
import clr
clr.AddReference("RevitAPI")
from Autodesk.Revit.DB import *
clr.AddReference("RevitServices")
import RevitServices
from RevitServices.Persistence import DocumentManager

doc = DocumentManager.Instance.CurrentDBDocument
type_name = []

filled_region_types = FilteredElementCollector(doc).OfClass(FilledRegionType).ToElements()

for filled_region_type in filled_region_types:
    type_name_param = filled_region_type.get_Parameter(BuiltInParameter.SYMBOL_NAME_PARAM)
    type_name.append(type_name_param.AsString())
    OUT = filled_region_type

#OUT = (type_name)
# ----------------------------------------
# note: Word box filled region in Revit
byCurves = FilledRegion.ByCurves(view=code_block_4, boundary=explode, regionType=python_script_3)
code_block_22 = CodeBlock { "Type Mark"; }
# note: Custom Node: Rhythm v.2021.6.1
ʳʰʸᵗʰᵐ_elements = Rhythm.Revit.Elements.Elements.SetParameterByNameTypeOrInstance(element=byCurves, parameterName=code_block_22, value=code_block_11)
byCurve_2 = DetailCurve.ByCurve(view=code_block_4, curve=code_block_21@L1)
code_block_23 = CodeBlock { 255; }
byARGB = Color.ByARGB(a=code_block_23, r=code_block_23, g=code_block_23, b=code_block_23)
overrideColorInView = Element.OverrideColorInView(element=byCurves, color=byARGB)

# group: Letters already guessed
# note: Custom Node: archilab v.2021.25.2621
get_filled_regions = Custom[Get Filled Regions]()  # package archi-lab.net; This node will query up all Filled Regions in the project as well as those in the active view only.
code_block_24 = CodeBlock(ONE=code_block_9, first=ʳʰʸᵗʰᵐ_elements, other=get_filled_regions.activeViewFilledRegions) { ONE == 1? first : other[0]; }
code_block_25 = CodeBlock { "Assembly Code"; }
get_type_parameter = Custom[Get Type Parameter](element=code_block_24, parameterName=code_block_25)  # package archi-lab.net; This node will retrieve a type parameter by its name.
code_block_26 = CodeBlock(i=get_type_parameter) { i[0]; }

# group: Popup 2
# note: IN
# [0] Firstname
# [1] Previous guesses
# [2] Run me
# note: OUT
# RESET - for resetting
# A letter when playing for a game
python_script_4 = Python(IN[0]=python_script_2, IN[1]=code_block_26, IN[2]=code_block_9)
# ---------- python_script_4.python (104 lines) ----------
import clr
clr.AddReference("System.Windows.Forms")
clr.AddReference("System.Drawing")
import System
from System.Windows.Forms import *
from System.Drawing import *

Firstname = IN[0]
Previous_guesses = IN[1]
Runme = IN[2]

class CreateWindow(Form):
	def __init__(self):
	        self.Name = "Create Window"
	        self.Text = "This is ©Hangman 2023, " + Firstname + " !"
	        self.Size = Size(380, 180)
	        self.CenterToScreen()
	                
	        label = Label(Text = "Guess a letter >>>")
	        label.Parent = self
	        label.Location = Point(15, 20)
	        label.AutoSize = False
	        label.Height = 50
	        label.Width = 100
	        label.ForeColor = Color.Green
	        
	        label = Label(Text = "Single, unguessed letters only please!")
	        label.Parent = self
	        label.Location = Point(180, 20)
	        label.AutoSize = False
	        label.Height = 50
	        label.Width = 120
	        label.ForeColor = Color.Red
	
	        self.textbox = TextBox()
	        self.textbox.Parent = self
	        self.textbox.Text = ""
	        self.textbox.Location = Point(115, 20)
	        self.textbox.Width = 40
	        self.textbox.ForeColor = Color.Red 
	
	        button = Button()
	        button.Parent = self
	        button.Text = "OK"
	        button.Location = Point(260, 70)
	        #button.Width = 100
	        button.Click += self.ButtonClicked
	        button.BackColor = Color.Green
	        button.ForeColor = Color.White
	        
	        # Create Checkbox
	        self.checkbox = CheckBox()
	        self.checkbox.Parent = self
	        self.checkbox.Text = "<< Reset"
	        self.checkbox.Location = Point(115, 70)
	        self.checkbox.AutoSize = True
	        self.checkbox.ForeColor = Color.Green
	        
	        
	        self.footer = Label()
	        self.footer.Parent = self
	        self.footer.Text = "Hanging is barbaric! Why are you playing this game you monster!"
	        self.footer.Location = Point(10, 115)
	        self.footer.AutoSize = True
	        self.footer.ForeColor = Color.Red
	        #self.footer.BorderStyle = BorderStyle.FixedSingle    
	
	        # Create Bottom Line
	        self.bottom_line = Label()
	        self.bottom_line.Parent = self
	        self.bottom_line.Location = Point(0, 100)
	        self.bottom_line.Size = Size(380, 3)
	        self.bottom_line.BorderStyle = BorderStyle.FixedSingle
	        self.bottom_line.ForeColor = Color.Black
	
			# Make the form always on top
	        self.TopMost = True

	def ButtonClicked(self, sender, args):
		if sender.Click:
			self.value = self.textbox.Text
			if self.checkbox.Checked:
				self.value = "RESET"
			elif len(self.textbox.Text.strip()) != 1 :
				return True
			elif not self.value.isalpha():
				return True
			else:            
				self.value = self.value.upper()
		self.Close()

# Call the form
if Runme[0] == "Hangman":
	form = CreateWindow()
	Application.Run(form)
	
	if form.value == True:
		form = CreateWindow()
		Application.Run(form)
	elif form.value in Previous_guesses:
		form = CreateWindow()
		Application.Run(form)		
	else:
		OUT = form.value
# ----------------------------------------

code_block_27 = CodeBlock(input=python_script_4, RevitView=activeView) { input == "RESET"? "" : RevitView; }
code_block_28 = CodeBlock(RevitActiveView=code_block_27) { RevitActiveView; }
code_block_29 = CodeBlock(AlreadyGuessed=code_block_26, NewGuess=python_script_4) { AlreadyGuessed + NewGuess; NewGuess; }

# group: Set word from Revit (after first go)
# note: Custom Node: archilab v.2021.25.2621
type = archilab.Revit.Elements.Elements.Type(element=code_block_24)
code_block_30 = CodeBlock { "Type Mark"; }
getParameterValueByName_2 = Element.GetParameterValueByName(element=type, parameterName=code_block_30)

code_block_31 = CodeBlock(ONE=code_block_9, first=code_block_11, other=getParameterValueByName_2) { ONE == 1? first : other[0]; }

# group: WORD 2 GUESS
# note: word to guess
toUpper = String.ToUpper(str=code_block_31)
code_block_32 = CodeBlock(i=toUpper) { i[0]; }

code_block_33 = CodeBlock(GuessedLetters=code_block_26) { GuessedLetters; }

# group: Unguessed letters
# note: See what letters have
# NOT been guessed  so far
python_script_5 = Python(IN[0]=code_block_32, IN[1]=code_block_33)
# ---------- python_script_5.python (27 lines) ----------
# Load the Python Standard and DesignScript Libraries
import sys
import clr
clr.AddReference('ProtoGeometry')
from Autodesk.DesignScript.Geometry import *

Word2Guess = IN[0]
GuessedLetters = IN[1]
if GuessedLetters == None:
	GuessedLetters = ""

letters = []
lettersleft = ""

if GuessedLetters > 0: 
	for i in GuessedLetters:
		letters.append(i)
	
	for letter in Word2Guess:
		if letter not in GuessedLetters:
			lettersleft += letter
	
	#remove duplicate letters
	OUT = ''.join(set(lettersleft))

else: 
	OUT = GuessedLetters
# ----------------------------------------
# note: Custom Node: Clockwork v.1.0.2
explode_2 = Custom[String.Explode](str=code_block_26)  # package Clockwork for Dynamo 2.x; Chops up a string into a list of characters

# group: Letter info
# note: Location of guessed letter
# OR output letter if it's not in word.
# IN
# [0] NEW guess
# [1] Unguessed letters
# [2] Word to guess
python_script_6 = Python(IN[0]=code_block_29.NewGuess, IN[1]=python_script_5, IN[2]=code_block_32)
# ---------- python_script_6.python (19 lines) ----------
import re

NEWguess = (IN[0].strip())
Letters2Guess = IN[1]
WholeWord = IN[2]

try: 
	if NEWguess == Letters2Guess:
			OUT = True ##This means the game is won
	elif NEWguess == "":
		pass
	else: 
		if NEWguess in Letters2Guess:
			indices = [i.start() for i in re.finditer(NEWguess, WholeWord)]
			OUT = indices #where is that letter in the word? 
		else: 
			OUT = NEWguess #failed guess
except:
	OUT = NEWguess
# ----------------------------------------

# group: Location points for all letters
centre_points_for_correct = CodeBlock(crv=code_block_13)  # "Centre points for correct letters"
# ---------- centre_points_for_correct.designscript (3 lines) ----------
Pts = Autodesk.DesignScript.Geometry.Curve.PointAtSegmentLength
(crv,Autodesk.DesignScript.Geometry.Curve.Length(crv)/2);
output = Geometry.Translate(Pts, 0, 500, 0);
# ----------------------------------------
getItemAtIndex_2 = List.GetItemAtIndex(list=centre_points_for_correct.output, index=python_script_6)

code_block_34 = CodeBlock(Word2Guess=code_block_32) { Word2Guess; }

# group: Word to guess - indexes of letters
# note: Custom Node: Clockwork v.1.0.2
explode_3 = Custom[String.Explode](str=code_block_34)
getItemAtIndex_3 = List.GetItemAtIndex(list=explode_3, index=python_script_6)

# group: Correct letter in Revit
code_block_35 = CodeBlock { "Middle"; }
byLocation = TextNote.ByLocation(view=code_block_28, location=getItemAtIndex_2, text=getItemAtIndex_3, alignment=code_block_35)

code_block_36 = CodeBlock(Arrgh=code_block_24) { Arrgh; }
code_block_37 = CodeBlock(input=python_script_4) { input == "RESET"? "" : "Assembly Code"; }

# group: Set assembly code parameter (guesses)
# note: Custom Node: Rhythm v.2021.6.1
ʳʰʸᵗʰᵐ_elements_2 = Rhythm.Revit.Elements.Elements.SetParameterByNameTypeOrInstance(element=code_block_36, parameterName=code_block_37, value=code_block_29.out0)

code_block_38 = CodeBlock(AllGuesses=code_block_29.out0) { AllGuesses; }
# note: Total number of guesses
length = String.Length(str=code_block_38)

# group: All guesses as text to Revit
code_block_39 = CodeBlock(i=flatten, n=length) { i[0..n]; }
# note: Custom Node: Clockwork v.1.0.2
explode_4 = Custom[String.Explode](str=code_block_38)
code_block_40 = CodeBlock { "Bottom"; }
byLocation_2 = TextNote.ByLocation(view=code_block_28, location=code_block_39, text=explode_4, alignment=code_block_40)

code_block_41 = CodeBlock(TotalGuessCount=length) { TotalGuessCount; }
code_block_42 = CodeBlock(Word2Guess=code_block_34) { Word2Guess; }

# group: Winner pop up
code_block_43 = CodeBlock(x=code_block_41, word=code_block_42, run=python_script_6) { "Hangman winner!"; "You won in " + x + " guesses!"; "The word was: " + word; 4; run; }
python_script_7 = Python(IN[0]=code_block_43.out0, IN[1]=code_block_43.out1, IN[2]=code_block_43.out2, IN[3]=code_block_43.out3, IN[4]=code_block_43.run)
# ---------- python_script_7.python (40 lines) ----------
import clr
clr.AddReference('RevitAPIUI')
from Autodesk.Revit.UI import TaskDialog, TaskDialogCommonButtons, TaskDialogResult, TaskDialogCommandLinkId, TaskDialogIcon

clr.AddReference("RevitServices")
import RevitServices
from RevitServices.Persistence import DocumentManager
doc = DocumentManager.Instance.CurrentDBDocument

import ctypes 
#Given any input will return a list containing that item (if it is already a list it just outputs it without change)
def tolist(obj1):
	if hasattr(obj1, "__iter__"): return str(obj1)[2:-2]
	else: return obj1
	
header = str(IN[0])
Main = tolist(IN[1])
SmallText = tolist(IN[2])
type =TaskDialogIcon.TaskDialogIconShield
run_me = IN[4]

mainDialog = TaskDialog(header)
mainDialog.MainInstruction = Main
mainDialog.MainContent = SmallText

if run_me == True:
		
	mainDialog.MainIcon = type
	
	mainDialog.CommonButtons = TaskDialogCommonButtons.Close;
	mainDialog.DefaultButton = TaskDialogResult.Close;
	
	mainDialog.FooterText = "Yissss";

	tResult = mainDialog.Show()
	
	OUT = tResult, ["Type Mark", "Assembly Code"], True
	
else:
	OUT = "","No pop-up Generated", False
# ----------------------------------------

# group: Incorrect guess count
# note: Bad letters - count
python_script_8 = Python(IN[0]=code_block_38, IN[1]=code_block_34)
# ---------- python_script_8.python (26 lines) ----------
# Load the Python Standard and DesignScript Libraries
import sys
import clr
clr.AddReference('ProtoGeometry')
from Autodesk.DesignScript.Geometry import *


AllGuessed = IN[0]
Word2Guess = IN[1]
letters = []
for i in AllGuessed:
	letters.append(i[0])

badlett = ""

for letter in AllGuessed:
	if letter not in Word2Guess:
		badlett += letter

#remove duplicate letters
badlett = ''.join(set(badlett))

if len(badlett) == 0:
	OUT = None
else:
	OUT = (len(badlett))
# ----------------------------------------

# group: Location for Revit
code_block_44 = CodeBlock(n=python_script_8) { 0..n-1; }
getItemAtIndex_4 = List.GetItemAtIndex(list=code_block_18, index=code_block_44)

# group: Hanged man
byCurve_3 = DetailCurve.ByCurve(view=code_block_28, curve=getItemAtIndex_4)
# note: Custom Node: Clockwork v.1.0.2
maroon = Custom[Color.Maroon]()  # package Clockwork for Dynamo 2.x; Returns the colour maroon.
overrideColorInView_2 = Element.OverrideColorInView(element=byCurve_3, color=maroon)

# group: Looser pop up
code_block_45 = CodeBlock(x=python_script_8) { x >= 6? true : false; }
code_block_46 = CodeBlock(x=code_block_41, word=code_block_42, run=code_block_45) { "You've been hanged!"; "You lost in " + x + " guesses!"; "The word was: " + word; run; }
python_script_9 = Python(IN[0]=code_block_46.out0, IN[1]=code_block_46.out1, IN[2]=code_block_46.out2, IN[3]=code_block_46.run)
# ---------- python_script_9.python (40 lines) ----------
import clr
clr.AddReference('RevitAPIUI')
from Autodesk.Revit.UI import TaskDialog, TaskDialogCommonButtons, TaskDialogResult, TaskDialogCommandLinkId, TaskDialogIcon

clr.AddReference("RevitServices")
import RevitServices
from RevitServices.Persistence import DocumentManager
doc = DocumentManager.Instance.CurrentDBDocument

import ctypes 
#Given any input will return a list containing that item (if it is already a list it just outputs it without change)
def tolist(obj1):
	if hasattr(obj1, "__iter__"): return str(obj1)[2:-2]
	else: return obj1
	
header = str(IN[0])
Main = tolist(IN[1])
SmallText = tolist(IN[2])
type =TaskDialogIcon.TaskDialogIconShield
run_me = IN[3]

mainDialog = TaskDialog(header)
mainDialog.MainInstruction = Main
mainDialog.MainContent = SmallText

if run_me == True:
		
	mainDialog.MainIcon = type
	
	mainDialog.CommonButtons = TaskDialogCommonButtons.Close;
	mainDialog.DefaultButton = TaskDialogResult.Close;
	
	mainDialog.FooterText = "Arrrgh!";

	tResult = mainDialog.Show()
	
	OUT = tResult, ["Type Mark", "Assembly Code"], True
	
else:
	OUT = "","No pop-up Generated", False
# ----------------------------------------

code_block_47 = CodeBlock(reset=python_script_4) { reset; }

# group: Filled region, lines + text notes from Revit
code_block_48 = CodeBlock { ["Text Notes" , "Lines"]; }
code_block_49 = CodeBlock(input=code_block_47, itemnames=code_block_48) { input == "RESET"? itemnames : ""; }
byName_2 = Category.ByName(name=code_block_49)
all_elements_of_category_2 = ElementsOfCategory(Category=byName_2)

# group: Delete filled region + text notes- reset game
delete = Element.Delete(element=all_elements_of_category_2)

code_block_50 = CodeBlock(ProjectInfo=all_elements_of_category) { ProjectInfo; }
code_block_51 = CodeBlock(ProjectInfo=code_block_50) { ProjectInfo; }

# group: Popup 1
# note: IN
# [0] Firstname
# [1] Previous guesses
# note: OUT = Hangman when button clicked
python_script_10 = Python(IN[0]=python_script_2, IN[1]=code_block_9)
# ---------- python_script_10.python (69 lines) ----------
import clr
clr.AddReference("System.Windows.Forms")
clr.AddReference("System.Drawing")
import System
from System.Windows.Forms import *
from System.Drawing import *

class CreateWindow(Form):
	def __init__(self):
	        self.Name = "Create Window"
	        self.Text = "This is ©Hangman 2023, " + IN[0] + " !"
	        self.Size = Size(360, 250)
	        self.CenterToScreen()
	                
	        label = Label(Text = "Welcome to hangman in Revit")
	        label.Parent = self
	        label.Location = Point(20, 20)
	        label.AutoSize = False
	        label.Height = 50
	        label.Width = 200
	        label.ForeColor = Color.Red
	        label.Font = Font(label.Font.Name, 16) # set font size to 16

	        label = Label (Text = " _______\n  |/      |\n  |      O \n  |      /|\ \n  |       |\n  |      / \\ \n  |\n_|_____ ")
	        label.Parent = self
	        label.Location = Point(220, 20)
	        label.AutoSize = False
	        label.Height = 100
	        label.Width = 200
	        label.ForeColor = Color.Red
	
	        button = Button()
	        button.Parent = self
	        button.Text = "Play the game already!"
	        button.Location = Point(120, 140)
	        button.Width = 200
	        button.Click += self.ButtonClicked
	        button.BackColor = Color.Green
	        button.ForeColor = Color.White     
	        
	        self.footer = Label()
	        self.footer.Parent = self
	        self.footer.Text = "Hanging is barbaric! Why are you playing this game you monster!"
	        self.footer.Location = Point(10, 175)
	        self.footer.AutoSize = True
	        self.footer.ForeColor = Color.Red
	        #self.footer.BorderStyle = BorderStyle.FixedSingle    
	
	        # Create Bottom Line
	        self.bottom_line = Label()
	        self.bottom_line.Parent = self
	        self.bottom_line.Location = Point(0, 150)
	        self.bottom_line.Size = Size(380, 3)
	        self.bottom_line.BorderStyle = BorderStyle.FixedSingle
	        self.bottom_line.ForeColor = Color.Black
	
			# Make the form always on top
	        self.TopMost = True

	def ButtonClicked(self, sender, args):
		if sender.Click:
			self.value = "Hangman"
			self.Close()

# Call the form
if IN[1][0] == 1:
	form = CreateWindow()
	Application.Run(form)
	OUT = form.value
# ----------------------------------------

# group: Set project name to, "Hangman"
code_block_52 = CodeBlock { "Project Name"; }
setParameterByName = Element.SetParameterByName(element=code_block_51, parameterName=code_block_52, value=python_script_10)

# group: Set project name to, "RESET"
code_block_53 = CodeBlock(input=code_block_47) { input == "RESET"? "Project Name" : ""; "RESET"; }
setParameterByName_2 = Element.SetParameterByName(element=code_block_51, parameterName=code_block_53.out0, value=code_block_53.out1)

# group: Reset assembly code because it's not deleting the filled region!
code_block_54 = CodeBlock(Arrgh=code_block_36, input=code_block_47) { Arrgh; input == "RESET"? ["Assembly Code", "Type Mark"] : ""; ""; }
# note: Custom Node: Rhythm v.2021.6.1
ʳʰʸᵗʰᵐ_elements_3 = Rhythm.Revit.Elements.Elements.SetParameterByNameTypeOrInstance(element=code_block_54.Arrgh, parameterName=code_block_54.out1, value=code_block_54.out2)
